# Grasshopper definition Chapter2.gh (Grasshopper 1.0.7)

# ---- group: Using arrays to display the days of the week
c_script = CSharpScript()  # -> out, A
# ---------- c_script: C# ----------
    // Declare and initialize the days of the week array
    string [] weekdays1 = {"Sunday", "Monday","Tuesday","Wednesday","Thursday","Friday","Saturday"};
    A = weekdays1;

    // Declare the days of the week in one statement then assign thr values later

    string [] weekdays = new string [7];
    weekdays[0] = "Sunday";
    weekdays[1] = "Monday";
    weekdays[2] = "Tuesday";
    weekdays[3] = "Wednesday";
    weekdays[4] = "Thursday";
    weekdays[5] = "Friday";
    weekdays[6] = "Saturday";

    A = weekdays;
# ---------- end c_script ----------
panel = Panel(c_script.A)

# ---- group: Using function "System"
c_script_2 = CSharpScript(x=Slider(8, range=0..10))  # -> out, A; inputs x: Double
# ---------- c_script_2: C# ----------
    /*double num = x;
    double sqrNum = System.Math.Sqrt(num);
    A = sqrNum;*/

    A = System.Math.Sqrt(x);
# ---------- end c_script_2 ----------
panel_2 = Panel(c_script_2.A)

# ---- group: While loop
c_script_3 = CSharpScript()  # -> out, A
# ---------- c_script_3: C# ----------
    int sum = 0;
    int counter = 0;
    int number = 2;

    //Loop
    while (sum < 1000)
    {
      sum = sum + number;
      // Make sure increment the counter and the number
      counter = counter + 1;
      number = number + 2;
    }

    //Remove lat number
    sum -= number;
    counter--;
    Print("Count = " + counter);
    Print("Sum = " + sum);
# ---------- end c_script_3 ----------
panel_3 = Panel(c_script_3.out)

# ---- group: Creating a list of workdays
c_script_4 = CSharpScript()  # -> out, A
# ---------- c_script_4: C# ----------
    List <string> myWorkDays = new List <string> ();

    myWorkDays.Add("Tuesday");
    myWorkDays.Add("Wednesday");
    myWorkDays.Add("Thursday");
    myWorkDays.Add("Friday");
    
    A = myWorkDays;
# ---------- end c_script_4 ----------
panel_4 = Panel(c_script_4.A)
